# Grasshopper definition housing.gh (Grasshopper 0.9.76)

height = Slider(30, range=20..50)
length = Slider(55.2, range=25..75)
width = Slider(60, range=25..75)

division = Division(A=height, B=2)
division_2 = Division(A=length, B=2)
division_3 = Division(A=width, B=2)
main_radius = Slider(5, range=0..10)
construct_point = ConstructPoint(XCoordinate=expr("-x", division_2), YCoordinate=expr("-x", division_3), ZCoordinate=expr("-x", division))
construct_point_2 = ConstructPoint(XCoordinate=division_2, YCoordinate=division_3, ZCoordinate=division)
xz_plane = XZPlane(Origin=Point(0, 0, 0))
yz_plane = YZPlane(Origin=Point(0, 0, 0))
xy_plane = XYPlane(Origin=Point(0, 0, 0))
subtraction = Subtraction(A=division_3, B=main_radius)
subtraction_2 = Subtraction(A=division_2, B=main_radius)
subtraction_3 = Subtraction(A=division, B=main_radius)
plane_offset = PlaneOffset(BasePlane=xy_plane, Offset=expr("-x", subtraction_3))
plane_offset_2 = PlaneOffset(BasePlane=xz_plane, Offset=expr("-x", subtraction))
plane_offset_3 = PlaneOffset(BasePlane=xy_plane, Offset=subtraction_3)
plane_offset_4 = PlaneOffset(BasePlane=xz_plane, Offset=subtraction)
plane_offset_5 = PlaneOffset(BasePlane=yz_plane, Offset=expr("-x", subtraction_2))
plane_offset_6 = PlaneOffset(BasePlane=yz_plane, Offset=subtraction_2)
construct_point_3 = ConstructPoint(XCoordinate=expr("-x", subtraction_2), YCoordinate=expr("-x", subtraction), ZCoordinate=expr("-x", subtraction_3))
construct_point_4 = ConstructPoint(XCoordinate=subtraction_2, YCoordinate=subtraction, ZCoordinate=subtraction_3)
rectangle_2pt = Rectangle2Pt(Plane=plane_offset_3, PointA=construct_point_2, PointB=construct_point, Radius=main_radius)  # -> Rectangle, Length
rectangle_2pt_2 = Rectangle2Pt(Plane=plane_offset_4, PointA=construct_point_2, PointB=construct_point, Radius=main_radius)  # -> Rectangle, Length
rectangle_2pt_3 = Rectangle2Pt(Plane=plane_offset, PointA=construct_point_2, PointB=construct_point, Radius=main_radius)  # -> Rectangle, Length
rectangle_2pt_4 = Rectangle2Pt(Plane=plane_offset_2, PointA=construct_point_2, PointB=construct_point, Radius=main_radius)  # -> Rectangle, Length
rectangle_2pt_5 = Rectangle2Pt(Plane=plane_offset_6, PointA=construct_point_2, PointB=construct_point, Radius=main_radius)  # -> Rectangle, Length
rectangle_2pt_6 = Rectangle2Pt(Plane=plane_offset_5, PointA=construct_point_2, PointB=construct_point, Radius=main_radius)  # -> Rectangle, Length
mirror = Mirror(Geometry=construct_point_4, Plane=yz_plane)  # -> Geometry, Transform
mirror_2 = Mirror(Geometry=construct_point_3, Plane=yz_plane)  # -> Geometry, Transform
loft = Loft(
    Curves=[rectangle_2pt.Rectangle, rectangle_2pt_3.Rectangle],
    Options={Adjust=False, Closed=False, LoftEnds=0, LoftSimp=0, LoftType=0, Rebuild=10, Refit=0.01})
loft_2 = Loft(
    Curves=[rectangle_2pt_2.Rectangle, rectangle_2pt_4.Rectangle],
    Options={Adjust=False, Closed=False, LoftEnds=0, LoftSimp=0, LoftType=0, Rebuild=10, Refit=0.01})
loft_3 = Loft(
    Curves=[rectangle_2pt_5.Rectangle, rectangle_2pt_6.Rectangle],
    Options={Adjust=False, Closed=False, LoftEnds=0, LoftSimp=0, LoftType=0, Rebuild=10, Refit=0.01})
mirror_3 = Mirror(Geometry=[mirror.Geometry, construct_point_4], Plane=xz_plane)  # -> Geometry, Transform
mirror_4 = Mirror(Geometry=[mirror_2.Geometry, construct_point_3], Plane=xz_plane)  # -> Geometry, Transform
cap_holes = CapHoles(Brep=loft)
cap_holes_2 = CapHoles(Brep=loft_2)
cap_holes_3 = CapHoles(Brep=loft_3)
sphere = Sphere(Base=[mirror_3.Geometry, construct_point_4, mirror.Geometry], Radius=main_radius)
sphere_2 = Sphere(Base=[mirror_4.Geometry, mirror_2.Geometry, construct_point_3], Radius=main_radius)
solid_union = SolidUnion(Breps=[cap_holes_2, cap_holes, cap_holes_3, sphere, sphere_2])

wall_thickness = Slider(1.5, range=1..3)
deconstruct_brep = DeconstructBrep(Brep=solid_union)  # -> Faces, Edges, Vertices
flatten_tree = FlattenTree(Tree=deconstruct_brep.Faces, Path="{0}")
offset = Offset(Surface=flatten_tree, Distance=expr("-x", wall_thickness), Retrim=True)
brep_join = BrepJoin(Breps=offset)  # -> Breps, Closed

vector_xyz = VectorXYZ(XComponent=expr("-x", Slider(2, range=0..5)), YComponent=expr("-x", Slider(3.8, range=0..5)), ZComponent=0)  # -> Vector, Length
number_slider = Slider(1, range=0..4)

# ---- group: Raspberry Pi
construct_point_5 = ConstructPoint(XCoordinate=Slider(-0.5, range=-5..5), YCoordinate=Slider(0, range=-5..5), ZCoordinate=Slider(-7, range=-10..5))
xy_plane_2 = XYPlane(Origin=Point(0, 0, 0))
yz_plane_2 = YZPlane(Origin=Point(0, 0, 0))
xz_plane_2 = XZPlane(Origin=Point(0, 0, 0))
plane_origin = PlaneOrigin(Base=xz_plane_2, Origin=construct_point_5)
plane_origin_2 = PlaneOrigin(Base=yz_plane_2, Origin=construct_point_5)
plane_origin_3 = PlaneOrigin(Base=xy_plane_2, Origin=construct_point_5)
number_slider_2 = Slider(1, range=0..1)
division_4 = Division(A=Slider(51.2, range=0..100), B=2)
division_5 = Division(A=Slider(21, range=0..100), B=2)
division_6 = Division(A=number_slider_2, B=2)
vector_xyz_2 = VectorXYZ(XComponent=division_4, YComponent=division_5, ZComponent=division_6)  # -> Vector, Length
reverse = Reverse(Vector=vector_xyz_2.Vector)
move = Move(Geometry=construct_point_5, Motion=vector_xyz_2.Vector)  # -> Geometry, Transform
move_2 = Move(Geometry=construct_point_5, Motion=reverse)  # -> Geometry, Transform
box_2pt = Box2Pt(PointA=move.Geometry, PointB=move_2.Geometry, Plane=plane_origin_3)

# ----
move_3 = Move(Geometry=move.Geometry, Motion=vector_xyz.Vector)  # -> Geometry, Transform
mirror_5 = Mirror(Geometry=move_3.Geometry, Plane=plane_origin)  # -> Geometry, Transform
create_set = CreateSet(List=[mirror_5.Geometry, move_3.Geometry])  # -> Set, Map
mirror_6 = Mirror(Geometry=create_set.Set, Plane=plane_origin_2)  # -> Geometry, Transform
create_set_2 = CreateSet(List=[create_set.Set, mirror_6.Geometry])  # -> Set, Map
cylinder = Cylinder(Base=create_set_2.Set, Radius=number_slider, Length=expr("-x", number_slider_2))
cap_holes_4 = CapHoles(Brep=cylinder)

addition = Addition(A=division_6, B=Slider(3.3, range=0..10))
plane_offset_7 = PlaneOffset(BasePlane=plane_origin_3, Offset=expr("-x", addition))
rectangle_2pt_7 = Rectangle2Pt(Plane=plane_offset_7, PointA=move.Geometry, PointB=move_2.Geometry, Radius=0)  # -> Rectangle, Length
offset_2 = Offset(Curve=rectangle_2pt_7.Rectangle, Distance=Slider(0.5, range=0..1), Plane=plane_offset_7, Corners=1)
xy_plane_3 = XYPlane(Origin=Point(0, 0, 0))
flatten_tree_2 = FlattenTree(Tree=offset_2, Path="{0}")
project = Project(Geometry=flatten_tree_2, Plane=xy_plane_3)  # -> Geometry, Transform
loft_4 = Loft(
    Curves=[project.Geometry, flatten_tree_2],
    Options={Adjust=False, Closed=False, LoftEnds=0, LoftSimp=0, LoftType=0, Rebuild=10, Refit=0.01})
cap_holes_5 = CapHoles(Brep=loft_4)

# ---- group: Raspberry Pi (continued)
solid_difference = SolidDifference(BrepsA=box_2pt, BrepsB=cap_holes_4)

# ----
plane_offset_8 = PlaneOffset(BasePlane=plane_origin_3, Offset=expr("-x", division_6))
xy_plane_4 = XYPlane(Origin=Point(0, 0, 0))
number_slider_3 = Slider(2, range=0..5)
project_2 = Project(Geometry=create_set_2.Set, Plane=plane_offset_8)  # -> Geometry, Transform
division_7 = Division(A=Slider(3.2, range=0..5), B=2)
plane_offset_9 = PlaneOffset(BasePlane=xy_plane_4, Offset=expr("-x", division))
circle_cnr = CircleCNR(Center=project_2.Geometry, Normal=plane_offset_8, Radius=division_7)
plane_offset_10 = PlaneOffset(BasePlane=plane_offset_8, Offset=number_slider_3)
project_3 = Project(Geometry=circle_cnr, Plane=plane_offset_9)  # -> Geometry, Transform
graft_tree = GraftTree(Tree=circle_cnr, IncludeEmptyLists=True, IncludeNullItems=True)
subtraction_4 = Subtraction(A=number_slider, B=Slider(0.2, range=0..1))
graft_tree_2 = GraftTree(Tree=project_3.Geometry, IncludeEmptyLists=True, IncludeNullItems=True)
project_4 = Project(Geometry=create_set_2.Set, Plane=plane_offset_10)  # -> Geometry, Transform
loft_5 = Loft(
    Curves=[graft_tree, graft_tree_2],
    Options={Adjust=False, Closed=False, LoftEnds=0, LoftSimp=0, LoftType=0, Rebuild=10, Refit=0.01})
cylinder_2 = Cylinder(Base=project_4.Geometry, Radius=subtraction_4, Length=expr("-x", number_slider_3))
flatten_tree_3 = FlattenTree(Tree=loft_5, Path="{0}")
cap_holes_6 = CapHoles(Brep=cylinder_2)
cap_holes_7 = CapHoles(Brep=flatten_tree_3)
solid_union_2 = SolidUnion(Breps=[cap_holes_7, cap_holes_6])

solid_union_3 = SolidUnion(Breps=[cap_holes_5, brep_join.Breps])
solid_difference_2 = SolidDifference(BrepsA=solid_union_3, BrepsB=solid_union_2)

gap = Slider(0.1, range=0..1)
xy_plane_5 = XYPlane(Origin=Point(0, 0, 0))
division_8 = Division(A=gap, B=2)
plane_offset_11 = PlaneOffset(BasePlane=xy_plane_5, Offset=expr("-x", division))
plane_offset_12 = PlaneOffset(BasePlane=xy_plane_5, Offset=division_8)
plane_offset_13 = PlaneOffset(BasePlane=xy_plane_5, Offset=expr("-x", division_8))
plane_offset_14 = PlaneOffset(BasePlane=xy_plane_5, Offset=division)
rectangle_2pt_8 = Rectangle2Pt(Plane=plane_offset_12, PointA=construct_point_2, PointB=construct_point, Radius=0)  # -> Rectangle, Length
rectangle_2pt_9 = Rectangle2Pt(Plane=plane_offset_13, PointA=construct_point_2, PointB=construct_point, Radius=0)  # -> Rectangle, Length
rectangle_2pt_10 = Rectangle2Pt(Plane=plane_offset_14, PointA=construct_point_2, PointB=construct_point, Radius=0)  # -> Rectangle, Length
rectangle_2pt_11 = Rectangle2Pt(Plane=plane_offset_11, PointA=construct_point_2, PointB=construct_point, Radius=0)  # -> Rectangle, Length
loft_6 = Loft(
    Curves=[rectangle_2pt_10.Rectangle, rectangle_2pt_9.Rectangle],
    Options={Adjust=False, Closed=False, LoftEnds=0, LoftSimp=0, LoftType=0, Rebuild=10, Refit=0.01})
loft_7 = Loft(
    Curves=[rectangle_2pt_8.Rectangle, rectangle_2pt_11.Rectangle],
    Options={Adjust=False, Closed=False, LoftEnds=0, LoftSimp=0, LoftType=0, Rebuild=10, Refit=0.01})
cap_holes_8 = CapHoles(Brep=loft_6)
cap_holes_9 = CapHoles(Brep=loft_7)
solid_difference_3 = SolidDifference(BrepsA=solid_union, BrepsB=cap_holes_8)
solid_difference_4 = SolidDifference(BrepsA=solid_union, BrepsB=cap_holes_9)
solid_difference_5 = SolidDifference(BrepsA=solid_difference_4, BrepsB=solid_difference_2)
solid_difference_6 = SolidDifference(BrepsA=solid_difference_3, BrepsB=solid_difference_2)
